# Grasshopper definition SP MODEL GH.gh (Grasshopper 1.0.7)
# plug-ins: Bifocals, Rhino.Inside for Autodesk Revit, ggRhinoIFC

ggifcmp = GgIFCMaterialProfile(Priority=-1)
material = CreateMaterial(Diffuse="grey", Specular=RGB(255, 255, 255), Emission=RGB(0, 0, 0), Transparency="0", Shine="1")
ggifcm = GgIFCMaterial(Name="concrete", Description=material, Category=material)

# ----
# FLOOR SLAB
number_slider = Slider(15600, range=0..100000)
rectangle = Rectangle(Plane=PlaneXY(0, 0, 0), XSize=number_slider, YSize=Slider(14400, range=0..100000), Radius=0)  # -> Rectangle, Length
Z = UnitZ(Factor=expr("-x", Slider(250, range=0..1000)))
area = Area(Geometry=rectangle.Rectangle)  # -> Area, Centroid
boundary = BoundarySurfaces(Edges=rectangle.Rectangle)
extr = Extrude(Base=boundary, Direction=Z)
area_2 = Area(Geometry=extr)  # -> Area, Centroid
preview = CustomPreview(Geometry=extr, Material=ColourSwatch(SwatchColor=RGB(97, 89, 89)))
geo = Geometry(extr)

panel = Panel(ggifcm)

# ----
# TOP BEAMS
number_slider_2 = Slider(14500, range=0..100000)
number_slider_3 = Slider(120, range=0..1000)
number_slider_4 = Slider(160, range=0..1000)
Z_2 = UnitZ(Factor=Slider(3450, range=0..10000))
Z_3 = UnitZ(Factor=Slider(2870, range=0..10000))
Z_4 = UnitZ(Factor=Slider(3980, range=0..10000))
Y = UnitY(Factor=Slider(11550, range=0..100000))
Z_5 = UnitZ(Factor=Slider(4480, range=0..10000))
Y_2 = UnitY(Factor=Slider(2720, range=0..10000))
X = UnitX(Factor=Slider(13150, range=0..100000))
Y_3 = UnitY(Factor=Slider(2950, range=0..10000))
rectangle_2 = Rectangle(Plane=PlaneXY(0, 0, 0), XSize=number_slider_2, YSize=number_slider_3, Radius=0)  # -> Rectangle, Length
Y_4 = UnitY(Factor=Slider(7300, range=0..10000))
X_2 = UnitX(Factor=Slider(2670, range=0..10000))
rectangle_3 = Rectangle(Plane=PlaneXY(0, 0, 0), XSize=number_slider_3, YSize=Slider(8970, range=0..10000), Radius=0)  # -> Rectangle, Length
boundary_2 = BoundarySurfaces(Edges=rectangle_3.Rectangle)
boundary_3 = BoundarySurfaces(Edges=rectangle_2.Rectangle)
Z_6 = UnitZ(Factor=number_slider_4)
Z_7 = UnitZ(Factor=number_slider_4)
extr_2 = Extrude(Base=boundary_3, Direction=Z_7)
extr_3 = Extrude(Base=boundary_2, Direction=Z_6)
move = Move(Geometry=extr_3, Motion=X_2)  # -> Geometry, Transform
move_2 = Move(Geometry=extr_3, Motion=X)  # -> Geometry, Transform
move_3 = Move(Geometry=extr_2, Motion=Y_2)  # -> Geometry, Transform
move_4 = Move(Geometry=extr_2, Motion=Y)  # -> Geometry, Transform
move_5 = Move(Geometry=extr_2, Motion=Y_4)  # -> Geometry, Transform
move_6 = Move(Geometry=[move.Geometry, move_2.Geometry], Motion=Y_3)  # -> Geometry, Transform
move_7 = Move(Geometry=move_5.Geometry, Motion=Z_2)  # -> Geometry, Transform
move_8 = Move(Geometry=move_3.Geometry, Motion=Z_4)  # -> Geometry, Transform
move_9 = Move(Geometry=move_4.Geometry, Motion=Z_3)  # -> Geometry, Transform
move_10 = Move(Geometry=move_6.Geometry, Motion=Z_5)  # -> Geometry, Transform
rotax = RotateAxis(Geometry=move_10.Geometry, Angle=degrees(Slider(7, range=0..10, expression="-x")), Axis=Line((0, 0, 0), (10, 0, 0)))  # -> Geometry, Transform
Y_5 = UnitY(Factor=Slider(740, range=0..1000, expression="-x"))
move_11 = Move(Geometry=rotax.Geometry, Motion=Y_5)  # -> Geometry, Transform

# ----
# CARPORT
number_slider_5 = Slider(8, range=0..10)
Y_6 = UnitY(Factor=Slider(2600, range=0..10000, expression="-x"))
X_3 = UnitX(Factor=Slider(5440, range=0..10000))
Y_7 = UnitY(Factor=Slider(522, range=0..1000, expression="-x"))
Z_8 = UnitZ(Factor=Slider(2820, range=0..10000))
Z_9 = UnitZ(Factor=Slider(200, range=0..1000))
rectangle_4 = Rectangle(Plane=PlaneXY(0, 0, 0), XSize=Slider(6960, range=0..10000), YSize=Slider(5950, range=0..10000), Radius=0)  # -> Rectangle, Length
rotate = Rotate(Geometry=rectangle_4.Rectangle, Angle=degrees(Slider(0, range=0..100)), Plane=PlaneXY(0, 0, 0))  # -> Geometry, Transform
move_12 = Move(Geometry=rotate.Geometry, Motion=X_3)  # -> Geometry, Transform
move_13 = Move(Geometry=move_12.Geometry, Motion=Y_6)  # -> Geometry, Transform
boundary_4 = BoundarySurfaces(Edges=move_13.Geometry)
move_14 = Move(Geometry=boundary_4, Motion=Z_8)  # -> Geometry, Transform
rotax_2 = RotateAxis(Geometry=move_14.Geometry, Angle=degrees(number_slider_5), Axis=Line((0, 0, 0), (10, 0, 0)))  # -> Geometry, Transform
move_15 = Move(Geometry=rotax_2.Geometry, Motion=Y_7)  # -> Geometry, Transform
extr_4 = Extrude(Base=move_15.Geometry, Direction=Z_9)

number_slider_6 = Slider(600, range=0..1000)
number_slider_7 = Slider(400, range=0..1000)

# ----
# LEGS
number_slider_8 = Slider(0, range=0..1, expression="-x")
rectangle_5 = Rectangle(Plane=PlaneXY(0, 0, 0), XSize=number_slider_7, YSize=number_slider_7, Radius=Slider(1, range=0..1))  # -> Rectangle, Length
Y_8 = UnitY(Factor=Slider(3180, range=0..10000, expression="-x"))
X_4 = UnitX(Factor=Slider(11650, range=0..100000))
Z_10 = UnitZ(Factor=number_slider_8)
X_5 = UnitX(Factor=Slider(5930, range=0..10000))
boundary_5 = BoundarySurfaces(Edges=rectangle_5.Rectangle)
Z_11 = UnitZ(Factor=Slider(2500, range=0..10000))
extr_5 = Extrude(Base=boundary_5, Direction=Z_11)
move_16 = Move(Geometry=extr_5, Motion=Y_8)  # -> Geometry, Transform

# ----
# STUMPS
number_slider_9 = Slider(1, range=0..1)
rectangle_6 = Rectangle(Plane=PlaneXY(0, 0, 0), XSize=number_slider_6, YSize=number_slider_6, Radius=number_slider_9)  # -> Rectangle, Length
Y_9 = UnitY(Factor=Slider(3270, range=0..10000, expression="-x"))
X_6 = UnitX(Factor=Slider(11500, range=0..100000))
Z_12 = UnitZ(Factor=Slider(600, range=0..1000, expression="-x"))
X_7 = UnitX(Factor=Slider(5840, range=0..10000))
boundary_6 = BoundarySurfaces(Edges=rectangle_6.Rectangle)
Z_13 = UnitZ(Factor=Slider(601, range=0..1000))
extr_6 = Extrude(Base=boundary_6, Direction=Z_13)
move_17 = Move(Geometry=extr_6, Motion=Y_9)  # -> Geometry, Transform
move_18 = Move(Geometry=move_17.Geometry, Motion=Z_12)  # -> Geometry, Transform

materials = QueryMaterials()
item = ListItem(Index=Slider(26, range=0..100), Wrap=True)
geodshape = AddGeometryDirectShape(Name="Floorplate_geometry", Geometry=geo, Material=item, TrackingMode=2)

materials_2 = QueryMaterials()

# ----
# POST 1
move_19 = Move(Geometry=move_16.Geometry, Motion=X_5)  # -> Geometry, Transform

# ----
# POST 1
move_20 = Move(Geometry=move_18.Geometry, Motion=X_7)  # -> Geometry, Transform

roof_angle = Slider(7, range=0..10)

# ----
# POST 2
move_21 = Move(Geometry=move_16.Geometry, Motion=X_4)  # -> Geometry, Transform

# ----
# ROOF
number_slider_10 = Slider(2550, range=0..10000)
Z_14 = UnitZ(Factor=number_slider_10)
debrep = DeconstructBrep(Brep=boundary)  # -> Faces, Edges, Vertices
move_22 = Move(Geometry=boundary, Motion=Z_14)  # -> Geometry, Transform
item_2 = ListItem(List=debrep.Edges, Index=Slider(6, range=0..10), Wrap=True)
rotax_3 = RotateAxis(Geometry=move_22.Geometry, Angle=degrees(roof_angle), Axis=item_2)  # -> Geometry, Transform
Z_15 = UnitZ(Factor=Slider(400, range=0..1000))
extr_7 = Extrude(Base=rotax_3.Geometry, Direction=Z_15)
preview_2 = CustomPreview(Geometry=extr_7, Material=ColourSwatch(SwatchColor=RGB(48, 22, 22)))

# ----
# EXTERIOR WALLS
number_slider_11 = Slider(1000, range=0..1000)
rectangle_7 = Rectangle(
    Plane=PlaneXY(0, 0, 0),
    XSize=Slider(10800, range=0..100000),
    YSize=Slider(9600, range=0..10000),
    Radius=Slider(0, range=0..100))  # -> Rectangle, Length
explode = Explode(Curve=rectangle_7.Rectangle, Recursive=True)  # -> Segments, Vertices
panel_2 = Panel("""3
0""")
panel_3 = Panel("""1
2
3""")
item_3 = ListItem(List=explode.Segments, Index=panel_2, Wrap=True)
item_4 = ListItem(List=explode.Segments, Index=panel_3, Wrap=True)
join = JoinCurves(Curves=item_3, Preserve=False)
join_2 = JoinCurves(Curves=item_4, Preserve=False)
fillet = Fillet(Curve=join_2, Radius=number_slider_11)
fillet_2 = Fillet(Curve=join, Radius=number_slider_11)
join_3 = JoinCurves(Curves=[fillet, fillet_2], Preserve=False)
boundary_7 = BoundarySurfaces(Edges=join_3)
area_3 = Area(Geometry=boundary_7)  # -> Area, Centroid
vec2pt = Vector2Pt(PointA=area_3.Centroid, PointB=area.Centroid, Unitize=False)  # -> Vector, Length
move_23 = Move(Geometry=boundary_7, Motion=vec2pt.Vector)  # -> Geometry, Transform
boundary_8 = BoundarySurfaces(Edges=move_23.Geometry)
divide = DivideCurve(Curve=move_23.Geometry, Count=Slider(50, range=0..100), Kinks=False)  # -> Points, Tangents, Parameters
offset = OffsetCurve(Curve=boundary_8, Distance=Slider(500, range=0..1000, expression="-x"), Corners=Slider(2, range=0..10))
Z_16 = UnitZ(Factor=Slider(5400, range=0..10000))
boundary_9 = BoundarySurfaces(Edges=offset)
sdiff = SolidDifference(BrepsA=boundary_8, BrepsB=boundary_9)
divide_2 = DivideCurve(Curve=offset, Count=Slider(100, range=0..100), Kinks=False)  # -> Points, Tangents, Parameters
extr_8 = Extrude(Base=sdiff, Direction=Z_16)
sdiff_2 = SolidDifference(BrepsA=extr_8, BrepsB=rotax_3.Geometry)
sdiff_3 = SolidDifference(BrepsA=extr_8, BrepsB=sdiff_2)

# ----
# POST 2
move_24 = Move(Geometry=move_18.Geometry, Motion=X_6)  # -> Geometry, Transform

geo_2 = Geometry(extr_4)
geo_3 = Geometry([move_21.Geometry, move_19.Geometry, move_20.Geometry, move_24.Geometry])

materials_3 = QueryMaterials()
item_5 = ListItem(Index=Slider(34, range=0..100), Wrap=True)
geodshape_2 = AddGeometryDirectShape(Name="Carport_geometry", Geometry=geo_2, Material=item_5, TrackingMode=2)

materials_4 = QueryMaterials()
item_6 = ListItem(Index=Slider(34, range=0..100), Wrap=True)
geodshape_3 = AddGeometryDirectShape(Name="Carport_legs_geometry", Geometry=geo_3, Material=item_6, TrackingMode=2)

ggifcrm = GgIFCRepresentationMap(IfcRepresentationItems=[geo_3, geo_2])
ggifcbept = GgIFCBuildingElementProxyType(PredefinedType=6, IfcRep=ggifcrm, Name="carport")
ggifcb = GgIFCBuilding(Name="carport", LongName="GH Building", BuildingComposition=3, ElevationOfRefHeight=0, ElevationOfTerrain=0)
xy = XYPlane(Origin=Point(0, 0, 0))
ggifce = GgIFCCreateElement(IFCContainer=ggifcb, IfcProductType=ggifcbept, Location=xy)
ggifcp = GgIFCProject(Name="carport")
ggbake = GgIFCBaketoFile(ggifce)

geo_4 = Geometry([move_8.Geometry, move_7.Geometry, move_9.Geometry, move_11.Geometry])
preview_3 = CustomPreview(Geometry=geo_4, Material=ColourSwatch(SwatchColor=RGB(24, 52, 237)))

ggifcrm_2 = GgIFCRepresentationMap(IfcRepresentationItems=geo_4)
ggifcbept_2 = GgIFCBuildingElementProxyType(PredefinedType=6, IfcRep=ggifcrm_2, Name="structuralbeams")
ggifcb_2 = GgIFCBuilding(Name="structuralbeams", LongName="GH Building", BuildingComposition=3, ElevationOfRefHeight=0, ElevationOfTerrain=0)
xy_2 = XYPlane(Origin=Point(0, 0, 0))
ggifce_2 = GgIFCCreateElement(IFCContainer=ggifcb_2, IfcProductType=ggifcbept_2, Location=xy_2)
ggifcp_2 = GgIFCProject(Name="structuralbeams")
ggbake_2 = GgIFCBaketoFile(ggifce_2)

# ----
# CARPORT
group = Group(Objects=[move_20.Geometry, move_24.Geometry, move_19.Geometry, move_21.Geometry])
preview_4 = CustomPreview(Geometry=[extr_4, group], Material=ColourSwatch(SwatchColor=RGB(120, 115, 115)))

materials_5 = QueryMaterials()
item_7 = ListItem(Index=Slider(8, range=0..100), Wrap=True)
geodshape_4 = AddGeometryDirectShape(Name="Structural_beams_geometry", Geometry=geo_4, Material=item_7, TrackingMode=2)

geo_5 = Geometry(extr_7)

ggifcrm_3 = GgIFCRepresentationMap(IfcRepresentationItems=geo_5)
ggifcbept_3 = GgIFCBuildingElementProxyType(PredefinedType=6, IfcRep=ggifcrm_3, Name="roof")
ggifcb_3 = GgIFCBuilding(Name="roof", LongName="GH Building", BuildingComposition=3, ElevationOfRefHeight=0, ElevationOfTerrain=0)
xy_3 = XYPlane(Origin=Point(0, 0, 0))
ggifce_3 = GgIFCCreateElement(IFCContainer=ggifcb_3, IfcProductType=ggifcbept_3, Location=xy_3)
ggifcp_3 = GgIFCProject(Name="roof")
ggbake_3 = GgIFCBaketoFile(ggifce_3)

materials_6 = QueryMaterials()
item_8 = ListItem(Index=Slider(31, range=0..100), Wrap=True)
geodshape_5 = AddGeometryDirectShape(Name="Roof_geometry", Geometry=geo_5, Material=item_8, TrackingMode=2)

number_slider_12 = Slider(77, range=0..100)
gggrasshoppersettings = GgGrasshopperSettings(
    SettingsData_IFCSettings_Format="STEP",
    SettingsData_IFCSettings_GenerateOwnerHistory=True,
    SettingsData_IFCSettings_IdentifyObsolete=False,
    SettingsData_IFCSettings_LastUsedUnits="Millimeters",
    SettingsData_IFCSettings_ModelViewDefinition="Ifc2x3Coordination",
    SettingsData_IFCSettings_Radians=True,
    SettingsData_RevitSettings_Format="STEP",
    SettingsData_RevitSettings_GenerateOwnerHistory=True,
    SettingsData_RevitSettings_IdentifyObsolete=True,
    SettingsData_RevitSettings_LastUsedUnits="Millimeters",
    SettingsData_RevitSettings_ModelViewDefinition="Ifc4DesignTransfer",
    SettingsData_RevitSettings_Radians=True)

# ----
# ENSUITE
number_slider_13 = Slider(90, range=0..100, expression="-x")
rectangle_8 = Rectangle(Plane=PlaneXY(0, 0, 0), XSize=Slider(100, range=0..100), YSize=Slider(2952, range=0..10000), Radius=0)  # -> Rectangle, Length
Y_10 = UnitY(Factor=Slider(4100, range=0..10000))
Y_11 = UnitY(Factor=Slider(3969, range=0..10000, expression="-x"))
item_9 = ListItem(List=divide_2.Points, Index="14", Wrap=True)
pt = Point(item_9)
move_25 = Move(Geometry=rectangle_8.Rectangle, Motion=pt)  # -> Geometry, Transform
rotate_2 = Rotate(Geometry=move_25.Geometry, Angle=degrees(number_slider_13), Plane=pt)  # -> Geometry, Transform
move_26 = Move(Geometry=rotate_2.Geometry, Motion=Y_10)  # -> Geometry, Transform
explode_2 = Explode(Curve=move_26.Geometry, Recursive=True)  # -> Segments, Vertices
item_10 = ListItem(List=explode_2.Vertices, Index="4", Wrap=True)

# ----
# MASTER BED
number_slider_14 = Slider(270, range=0..1000)
rectangle_9 = Rectangle(Plane=PlaneXY(0, 0, 0), XSize=Slider(100, range=0..100), YSize=Slider(5520, range=0..10000), Radius=0)  # -> Rectangle, Length
item_11 = ListItem(List=divide_2.Points, Index="10", Wrap=True)
pt_2 = Point(item_11)
move_27 = Move(Geometry=rectangle_9.Rectangle, Motion=pt_2)  # -> Geometry, Transform
rotate_3 = Rotate(Geometry=move_27.Geometry, Angle=degrees(number_slider_14), Plane=pt_2)  # -> Geometry, Transform

number_slider_15 = Slider(100, range=0..100)
number_slider_16 = Slider(1088, range=0..10000, expression="-x")

# ----
# TOLIET
number_slider_17 = Slider(90, range=0..100)
rectangle_10 = Rectangle(Plane=PlaneXY(0, 0, 0), XSize=Slider(100, range=0..100), YSize=Slider(2670, range=0..10000), Radius=0)  # -> Rectangle, Length
Y_12 = UnitY(Factor=Slider(1000, range=0..1000))
rectangle_11 = Rectangle(Plane=PlaneXY(0, 0, 0), XSize=number_slider_15, YSize=Slider(1010, range=0..10000), Radius=0)  # -> Rectangle, Length
rectangle_12 = Rectangle(Plane=PlaneXY(0, 0, 0), XSize=number_slider_15, YSize=Slider(1230, range=0..10000), Radius=0)  # -> Rectangle, Length
X_8 = UnitX(Factor=Slider(5728, range=0..10000, expression="-x"))
Y_13 = UnitY(Factor=Slider(410, range=0..1000, expression="-x"))
X_9 = UnitX(Factor=Slider(4385, range=0..10000, expression="-x"))
X_10 = UnitX(Factor=Slider(99, range=0..100, expression="-x"))
Y_14 = UnitY(Factor=1)
Y_15 = UnitY(Factor=Slider(180, range=0..1000))
item_12 = ListItem(List=divide_2.Points, Index="64", Wrap=True)
pt_3 = Point(item_12)
move_28 = Move(Geometry=rectangle_11.Rectangle, Motion=pt_3)  # -> Geometry, Transform
move_29 = Move(Geometry=rectangle_12.Rectangle, Motion=pt_3)  # -> Geometry, Transform
rotate_4 = Rotate(Geometry=move_28.Geometry, Angle=degrees(number_slider_17), Plane=pt_3)  # -> Geometry, Transform
rotate_5 = Rotate(Geometry=move_29.Geometry, Angle=degrees(number_slider_17), Plane=pt_3)  # -> Geometry, Transform
move_30 = Move(Geometry=rectangle_10.Rectangle, Motion=pt_3)  # -> Geometry, Transform
move_31 = Move(Geometry=rotate_4.Geometry, Motion=X_8)  # -> Geometry, Transform
rotate_6 = Rotate(Geometry=move_30.Geometry, Angle=degrees(number_slider_17), Plane=pt_3)  # -> Geometry, Transform
move_32 = Move(Geometry=rotate_5.Geometry, Motion=X_9)  # -> Geometry, Transform
move_33 = Move(Geometry=rotate_6.Geometry, Motion=Y_12)  # -> Geometry, Transform
move_34 = Move(Geometry=move_31.Geometry, Motion=Y_13)  # -> Geometry, Transform
move_35 = Move(Geometry=move_32.Geometry, Motion=Y_15)  # -> Geometry, Transform
explode_3 = Explode(Curve=move_35.Geometry, Recursive=True)  # -> Segments, Vertices
item_13 = ListItem(List=explode_3.Vertices, Index="3", Wrap=True)
rotate_7 = Rotate(Geometry=move_35.Geometry, Angle=degrees(Slider(270, range=0..1000)), Plane=item_13)  # -> Geometry, Transform

# ----
# LAUNDRY
number_slider_18 = Slider(180, range=0..1000)
rectangle_13 = Rectangle(Plane=PlaneXY(0, 0, 0), XSize=Slider(100, range=0..100), YSize=Slider(3320, range=0..10000), Radius=0)  # -> Rectangle, Length
X_11 = UnitX(Factor=Slider(535, range=0..1000))
item_14 = ListItem(List=divide_2.Points, Index="81", Wrap=True)
pt_4 = Point(item_14)
move_36 = Move(Geometry=rectangle_13.Rectangle, Motion=pt_4)  # -> Geometry, Transform
rotate_8 = Rotate(Geometry=move_36.Geometry, Angle=degrees(number_slider_18), Plane=pt_4)  # -> Geometry, Transform
move_37 = Move(Geometry=rotate_8.Geometry, Motion=X_11)  # -> Geometry, Transform
explode_4 = Explode(Curve=move_37.Geometry, Recursive=True)  # -> Segments, Vertices
item_15 = ListItem(List=explode_4.Vertices, Index="2", Wrap=True)

X_12 = UnitX(Factor=Slider(161, range=0..1000, expression="-x"))
Y_16 = UnitY(Factor=Slider(0, range=0..100))
move_38 = Move(Geometry=rotate_3.Geometry, Motion=Y_16)  # -> Geometry, Transform
X_13 = UnitX(Factor=Slider(102, range=0..1000, expression="-x"))
move_39 = Move(Geometry=rotate_7.Geometry, Motion=X_13)  # -> Geometry, Transform
Y_17 = UnitY(Factor=Slider(101, range=0..1000))
move_40 = Move(Geometry=move_39.Geometry, Motion=Y_17)  # -> Geometry, Transform
number_slider_19 = Slider(120, range=0..1000)

# ----
# Main window dimensions
number_slider_20 = Slider(500, range=0..1000)
number_slider_21 = Slider(1000, range=0..1000)
rectangle_14 = Rectangle(Plane=PlaneXY(0, 0, 0), XSize=number_slider_21, YSize=number_slider_20, Radius=0)  # -> Rectangle, Length
rectangle_15 = Rectangle(Plane=PlaneXY(0, 0, 0), XSize=number_slider_21, YSize=Slider(50, range=0..100), Radius=0)  # -> Rectangle, Length

# ----
# LEFT
number_slider_22 = Slider(3230, range=0..10000)

# ----
# BACK
panel_4 = Panel("47")
number_slider_23 = Slider(180, range=0..1000)
item_16 = ListItem(List=divide.Points, Index=panel_4, Wrap=True)
pt_5 = Point(item_16)
Z_17 = UnitZ(Factor=number_slider_22)
X_14 = UnitX(Factor=Slider(1011, range=0..10000))
X_15 = UnitX(Factor=Slider(7200, range=0..10000))
X_16 = UnitX(Factor=Slider(5211, range=0..10000))
X_17 = UnitX(Factor=Slider(3400, range=0..10000))

# ----
# FRONT
panel_5 = Panel("13")
item_17 = ListItem(List=divide.Points, Index=panel_5, Wrap=True)
X_18 = UnitX(Factor=Slider(2900, range=0..10000))
X_19 = UnitX(Factor=Slider(4100, range=0..10000))
X_20 = UnitX(Factor=Slider(5300, range=0..10000))
X_21 = UnitX(Factor=Slider(6500, range=0..10000))
Z_18 = UnitZ(Factor=Slider(4100, range=0..10000))
pt_6 = Point(item_17)

# ----
# MIDDLE
number_slider_24 = Slider(50, range=0..100)
# DIMENSIONS
number_slider_25 = Slider(1000, range=0..1000)

number_slider_26 = Slider(90, range=0..1000)
item_18 = ListItem(List=divide.Points, Index="31", Wrap=True)
item_19 = ListItem(List=divide.Points, Index="33", Wrap=True)
item_20 = ListItem(List=divide.Points, Index="27", Wrap=True)
pt_7 = Point(item_19)
pt_8 = Point(item_18)
pt_9 = Point(item_20)
Y_18 = UnitY(Factor=Slider(1100, range=0..10000, expression="-x"))
Z_19 = UnitZ(Factor=Slider(4000, range=0..10000))
Z_20 = UnitZ(Factor=Slider(3200, range=0..10000))
Z_21 = UnitZ(Factor=Slider(3600, range=0..10000))
Z_22 = UnitZ(Factor=Slider(3900, range=0..10000))

rectangle_16 = Rectangle(Plane=PlaneXY(0, 0, 0), XSize=number_slider_25, YSize=number_slider_24, Radius=0)  # -> Rectangle, Length
Z_23 = UnitZ(Factor=number_slider_25)
move_41 = Move(Geometry=rectangle_16.Rectangle, Motion=Z_23)  # -> Geometry, Transform

move_42 = Move(Geometry=rectangle_14.Rectangle, Motion=pt_6)  # -> Geometry, Transform
move_43 = Move(Geometry=move_42.Geometry, Motion=[X_18, X_19, X_20, X_21])  # -> Geometry, Transform
boundary_10 = BoundarySurfaces(Edges=[move_43.Geometry, move_42.Geometry])

move_44 = Move(Geometry=rectangle_14.Rectangle, Motion=pt_5)  # -> Geometry, Transform
rotate_9 = Rotate(Geometry=move_44.Geometry, Angle=degrees(number_slider_23), Plane=pt_5)  # -> Geometry, Transform
move_45 = Move(Geometry=rotate_9.Geometry, Motion=[X_14, X_17, X_15, X_16])  # -> Geometry, Transform
boundary_11 = BoundarySurfaces(Edges=move_45.Geometry)

item_21 = ListItem(List=divide.Points, Index="7", Wrap=True)
number_slider_27 = Slider(90, range=0..100, expression="-x")
number_slider_28 = Slider(90, range=0..100, expression="-x")
number_slider_29 = Slider(90, range=0..100, expression="-x")
item_22 = ListItem(List=divide.Points, Index="5", Wrap=True)
item_23 = ListItem(List=divide.Points, Index="2", Wrap=True)
pt_10 = Point(item_21)
pt_11 = Point(item_23)
pt_12 = Point(item_22)
Z_24 = UnitZ(Factor=Slider(3420, range=0..10000))
Z_25 = UnitZ(Factor=Slider(3600, range=0..10000))
Z_26 = UnitZ(Factor=Slider(4000, range=0..10000))

move_46 = Move(Geometry=rectangle_15.Rectangle, Motion=pt_5)  # -> Geometry, Transform
rotate_10 = Rotate(Geometry=move_46.Geometry, Angle=degrees(number_slider_23), Plane=pt_5)  # -> Geometry, Transform
move_47 = Move(Geometry=rotate_10.Geometry, Motion=[X_14, X_17, X_15])  # -> Geometry, Transform
boundary_12 = BoundarySurfaces(Edges=move_47.Geometry)

# ----
# WINDOWS
move_48 = Move(Geometry=rectangle_15.Rectangle, Motion=pt_7)  # -> Geometry, Transform
move_49 = Move(Geometry=rectangle_15.Rectangle, Motion=pt_8)  # -> Geometry, Transform
move_50 = Move(Geometry=rectangle_15.Rectangle, Motion=pt_9)  # -> Geometry, Transform
# PLACEMENT
rotate_11 = Rotate(Geometry=move_48.Geometry, Angle=degrees(number_slider_26), Plane=pt_7)  # -> Geometry, Transform
rotate_12 = Rotate(Geometry=move_49.Geometry, Angle=degrees(number_slider_26), Plane=pt_8)  # -> Geometry, Transform
rotate_13 = Rotate(Geometry=move_50.Geometry, Angle=degrees(number_slider_26), Plane=pt_9)  # -> Geometry, Transform
move_51 = Move(Geometry=rotate_13.Geometry, Motion=Y_18)  # -> Geometry, Transform
boundary_13 = BoundarySurfaces(Edges=rotate_11.Geometry)
boundary_14 = BoundarySurfaces(Edges=rotate_12.Geometry)
boundary_15 = BoundarySurfaces(Edges=rotate_13.Geometry)
boundary_16 = BoundarySurfaces(Edges=move_51.Geometry)
move_52 = Move(Geometry=[boundary_13, boundary_14, boundary_15, boundary_16], Motion=Z_23)  # -> Geometry, Transform

move_53 = Move(Geometry=rectangle_15.Rectangle, Motion=pt_7)  # -> Geometry, Transform
move_54 = Move(Geometry=rectangle_15.Rectangle, Motion=pt_8)  # -> Geometry, Transform
move_55 = Move(Geometry=rectangle_15.Rectangle, Motion=pt_9)  # -> Geometry, Transform
move_56 = Move(Geometry=rectangle_14.Rectangle, Motion=pt_8)  # -> Geometry, Transform
move_57 = Move(Geometry=rectangle_14.Rectangle, Motion=pt_9)  # -> Geometry, Transform
move_58 = Move(Geometry=rectangle_14.Rectangle, Motion=pt_7)  # -> Geometry, Transform
rotate_14 = Rotate(Geometry=move_53.Geometry, Angle=degrees(number_slider_26), Plane=pt_7)  # -> Geometry, Transform
rotate_15 = Rotate(Geometry=move_54.Geometry, Angle=degrees(number_slider_26), Plane=pt_8)  # -> Geometry, Transform
rotate_16 = Rotate(Geometry=move_55.Geometry, Angle=degrees(number_slider_26), Plane=pt_9)  # -> Geometry, Transform
move_59 = Move(Geometry=rotate_16.Geometry, Motion=Y_18)  # -> Geometry, Transform
rotate_17 = Rotate(Geometry=move_58.Geometry, Angle=degrees(number_slider_26), Plane=pt_7)  # -> Geometry, Transform
rotate_18 = Rotate(Geometry=move_56.Geometry, Angle=degrees(number_slider_26), Plane=pt_8)  # -> Geometry, Transform
rotate_19 = Rotate(Geometry=move_57.Geometry, Angle=degrees(number_slider_26), Plane=pt_9)  # -> Geometry, Transform
move_60 = Move(Geometry=rotate_19.Geometry, Motion=Y_18)  # -> Geometry, Transform
boundary_17 = BoundarySurfaces(Edges=rotate_14.Geometry)
boundary_18 = BoundarySurfaces(Edges=rotate_15.Geometry)
boundary_19 = BoundarySurfaces(Edges=rotate_16.Geometry)
boundary_20 = BoundarySurfaces(Edges=move_59.Geometry)
boundary_21 = BoundarySurfaces(Edges=rotate_17.Geometry)
boundary_22 = BoundarySurfaces(Edges=rotate_18.Geometry)
boundary_23 = BoundarySurfaces(Edges=rotate_19.Geometry)
boundary_24 = BoundarySurfaces(Edges=move_60.Geometry)

extr_9 = Extrude(Base=boundary_11, Direction=Z_17)
sdiff_4 = SolidDifference(BrepsA=extr_9, BrepsB=sdiff_3)
sdiff_5 = SolidDifference(BrepsA=extr_9, BrepsB=sdiff_4)
extr_10 = Extrude(Base=[boundary_23, boundary_22, boundary_21, boundary_24], Direction=[Z_22, Z_21, Z_20, Z_19])

move_61 = Move(Geometry=rectangle_14.Rectangle, Motion=pt_10)  # -> Geometry, Transform
move_62 = Move(Geometry=rectangle_14.Rectangle, Motion=pt_12)  # -> Geometry, Transform
move_63 = Move(Geometry=rectangle_14.Rectangle, Motion=pt_11)  # -> Geometry, Transform
move_64 = Move(Geometry=rectangle_15.Rectangle, Motion=pt_10)  # -> Geometry, Transform
move_65 = Move(Geometry=rectangle_15.Rectangle, Motion=pt_12)  # -> Geometry, Transform
move_66 = Move(Geometry=rectangle_15.Rectangle, Motion=pt_11)  # -> Geometry, Transform
rotate_20 = Rotate(Geometry=move_61.Geometry, Angle=degrees(number_slider_27), Plane=pt_10)  # -> Geometry, Transform
rotate_21 = Rotate(Geometry=move_62.Geometry, Angle=degrees(number_slider_28), Plane=pt_12)  # -> Geometry, Transform
rotate_22 = Rotate(Geometry=move_63.Geometry, Angle=degrees(number_slider_29), Plane=pt_11)  # -> Geometry, Transform
rotate_23 = Rotate(Geometry=move_64.Geometry, Angle=degrees(number_slider_27), Plane=pt_10)  # -> Geometry, Transform
rotate_24 = Rotate(Geometry=move_65.Geometry, Angle=degrees(number_slider_28), Plane=pt_12)  # -> Geometry, Transform
rotate_25 = Rotate(Geometry=move_66.Geometry, Angle=degrees(number_slider_29), Plane=pt_11)  # -> Geometry, Transform
boundary_25 = BoundarySurfaces(Edges=rotate_20.Geometry)
boundary_26 = BoundarySurfaces(Edges=rotate_21.Geometry)
boundary_27 = BoundarySurfaces(Edges=rotate_22.Geometry)
boundary_28 = BoundarySurfaces(Edges=rotate_23.Geometry)
boundary_29 = BoundarySurfaces(Edges=rotate_24.Geometry)
boundary_30 = BoundarySurfaces(Edges=rotate_25.Geometry)

move_67 = Move(Geometry=move_41.Geometry, Motion=pt_10)  # -> Geometry, Transform
move_68 = Move(Geometry=move_41.Geometry, Motion=pt_12)  # -> Geometry, Transform
move_69 = Move(Geometry=move_41.Geometry, Motion=pt_11)  # -> Geometry, Transform
rotate_26 = Rotate(Geometry=move_67.Geometry, Angle=degrees(number_slider_27), Plane=pt_10)  # -> Geometry, Transform
rotate_27 = Rotate(Geometry=move_68.Geometry, Angle=degrees(number_slider_28), Plane=pt_12)  # -> Geometry, Transform
rotate_28 = Rotate(Geometry=move_69.Geometry, Angle=degrees(number_slider_29), Plane=pt_11)  # -> Geometry, Transform
boundary_31 = BoundarySurfaces(Edges=rotate_26.Geometry)
boundary_32 = BoundarySurfaces(Edges=rotate_27.Geometry)
boundary_33 = BoundarySurfaces(Edges=rotate_28.Geometry)

extr_11 = Extrude(Base=boundary_12, Direction=Z_17)
sdiff_6 = SolidDifference(BrepsA=extr_11, BrepsB=extr_7)
Y_19 = UnitY(Factor=Slider(214, range=0..1000, expression="-x"))
move_70 = Move(Geometry=sdiff_6, Motion=Y_19)  # -> Geometry, Transform

# ----
# RIGHT
Z_27 = UnitZ(Factor=Z_23)

extr_12 = Extrude(Base=boundary_10, Direction=Z_18)
sdiff_7 = SolidDifference(BrepsA=extr_12, BrepsB=sdiff_3)
move_71 = Move(Geometry=rectangle_15.Rectangle, Motion=pt_6)  # -> Geometry, Transform
move_72 = Move(Geometry=move_71.Geometry, Motion=[X_18, X_19, X_20, X_21])  # -> Geometry, Transform
boundary_34 = BoundarySurfaces(Edges=[move_72.Geometry, move_71.Geometry])
extr_13 = Extrude(Base=boundary_34, Direction=Z_18)
sdiff_8 = SolidDifference(BrepsA=extr_13, BrepsB=extr_7)
Y_20 = UnitY(Factor=Slider(214, range=0..1000))
move_73 = Move(Geometry=sdiff_8, Motion=Y_20)  # -> Geometry, Transform

extr_14 = Extrude(Base=[boundary_19, boundary_18, boundary_17, boundary_20], Direction=[Z_22, Z_21, Z_20, Z_19])
sdiff_9 = SolidDifference(BrepsA=extr_14, BrepsB=extr_7)
X_22 = UnitX(Factor=Slider(214, range=0..1000, expression="-x"))
move_74 = Move(Geometry=sdiff_9, Motion=X_22)  # -> Geometry, Transform

# ----
# HEIGHT
X_23 = UnitX(Factor=Slider(200, range=0..1000, expression="-x"))
extr_15 = Extrude(Base=move_52.Geometry, Direction=Z_27)
move_75 = Move(Geometry=extr_15, Motion=X_23)  # -> Geometry, Transform
sdiff_10 = SolidDifference(BrepsA=move_75.Geometry, BrepsB=move_74.Geometry)

extr_16 = Extrude(Base=[boundary_31, boundary_32, boundary_33], Direction=Z_27)
X_24 = UnitX(Factor=Slider(200, range=0..1000))
move_76 = Move(Geometry=extr_16, Motion=X_24)  # -> Geometry, Transform
sdiff_11 = SolidDifference(BrepsA=move_76.Geometry, BrepsB=move_74.Geometry)
sdiff_12 = SolidDifference(BrepsA=move_76.Geometry, BrepsB=sdiff_11)

boundary_35 = BoundarySurfaces(Edges=move_47.Geometry)
move_77 = Move(Geometry=boundary_35, Motion=Z_23)  # -> Geometry, Transform

extr_17 = Extrude(Base=move_77.Geometry, Direction=Z_27)
Y_21 = UnitY(Factor=Slider(200, range=0..1000, expression="-x"))
move_78 = Move(Geometry=extr_17, Motion=Y_21)  # -> Geometry, Transform
sdiff_13 = SolidDifference(BrepsA=move_78.Geometry, BrepsB=move_74.Geometry)
sdiff_14 = SolidDifference(BrepsA=move_78.Geometry, BrepsB=sdiff_13)

extr_18 = Extrude(Base=[boundary_25, boundary_26, boundary_27], Direction=[Z_26, Z_25, Z_24])
extr_19 = Extrude(Base=[boundary_28, boundary_29, boundary_30], Direction=[Z_26, Z_25, Z_24])
sdiff_15 = SolidDifference(BrepsA=extr_18, BrepsB=extr_7)
sdiff_16 = SolidDifference(BrepsA=extr_19, BrepsB=extr_7)
X_25 = UnitX(Factor=Slider(214, range=0..1000))
move_79 = Move(Geometry=sdiff_16, Motion=X_25)  # -> Geometry, Transform

move_80 = Move(Geometry=move_41.Geometry, Motion=pt_6)  # -> Geometry, Transform
move_81 = Move(Geometry=move_80.Geometry, Motion=[X_18, X_19, X_20, X_21])  # -> Geometry, Transform
boundary_36 = BoundarySurfaces(Edges=[move_81.Geometry, move_80.Geometry])

Y_22 = UnitY(Factor=Slider(200, range=0..1000))
extr_20 = Extrude(Base=boundary_36, Direction=Z_27)
move_82 = Move(Geometry=extr_20, Motion=Y_22)  # -> Geometry, Transform
sdiff_17 = SolidDifference(BrepsA=move_82.Geometry, BrepsB=move_74.Geometry)
sdiff_18 = SolidDifference(BrepsA=move_82.Geometry, BrepsB=sdiff_17)

geo_6 = Geometry([sdiff_10, sdiff_18, sdiff_12, sdiff_14])

materials_7 = QueryMaterials()
item_24 = ListItem(Index=Slider(58, range=0..100), Wrap=True)
geodshape_6 = AddGeometryDirectShape(Name="Middle_Window_geometry", Geometry=geo_6, Material=item_24, TrackingMode=2)

geo_7 = Geometry([move_74.Geometry, move_73.Geometry, move_70.Geometry, move_79.Geometry])

# ----
# EXTERIOR WINDOWS
geo_8 = Geometry([move_74.Geometry, move_70.Geometry, move_79.Geometry, move_73.Geometry])
preview_5 = CustomPreview(Geometry=geo_7, Material=ColourSwatch(SwatchColor=RGBA(105, 130, 255, 73)))

# ----
# EXTERIOR WALLS
sdiff_19 = SolidDifference(BrepsA=[extr_10, extr_12, sdiff_5, sdiff_15], BrepsB=extr_7)
sdiff_20 = SolidDifference(BrepsA=sdiff_3, BrepsB=sdiff_19)
preview_6 = CustomPreview(Geometry=sdiff_20, Material=ColourSwatch(SwatchColor=RGB(115, 110, 110)))

# ----
# Middle window colour
swatch = ColourSwatch(SwatchColor=RGB(235, 135, 42))
preview_7 = CustomPreview(Geometry=[sdiff_18, sdiff_12, sdiff_14, sdiff_10], Material=swatch)

geo_9 = Geometry(sdiff_20)

# ----
# SUN PATH ANALYSIS
ladybug = Ladybug_Ladybug()  # -> Vviiiiiiiiiizzz; disabled; plug-in component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
panel_6 = Panel("http://climate.onebuilding.org/WMO_Region_5_Southwest_Pacific/AUS_Australia/NSW_New_South_Wales/AUS_NSW_Sydney.RO-Observatory.Hill.947680_17_SY_CZ0512_RMY2012A.zip")  # disabled
panel_7 = Panel(ladybug)  # disabled
downloadepw = LBDownloadWeather(weather_URL=panel_6)  # -> epw_file, stat_file, ddy_file; disabled; plug-in component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
importepw = LBImportEPW(epw_file=downloadepw.epw_file)  # -> location, dry_bulb_temperature, dew_point_temperature, relative_humidity, wind_speed, wind_direction, direct_normal_rad, diffuse_horizontal_rad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; disabled; plug-in component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
number_slider_30 = Slider(12, range=1..12)  # disabled
number_slider_31 = Slider(25, range=1..30)  # disabled
number_slider_32 = Slider(12, range=1..24)  # disabled
number_slider_33 = Slider(0.2, range=0..1)  # disabled
hoy = LBCalculateHOY(month=number_slider_30, day=number_slider_31, hour=number_slider_32)  # -> flatten(hoy), flatten(doy), flatten(date); disabled; plug-in component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
pt_13 = Point(area_2.Centroid)  # disabled
sunpath = LBSunPath(location=importepw.location, hoys=hoy.hoy, center_pt=pt_13, scale=number_slider_33)  # -> out, vectors, altitudes, azimuths, hoys, sun_pts, analemma, daily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; disabled; plug-in component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
number_slider_34 = Slider(20, range=0..100)  # disabled
boolean_toggle = BooleanToggle(True)  # disabled
number_slider_35 = Slider(1000, range=0..1000)  # disabled
directsunhours = LBDirectSunHours(
    vectors=flatten(sunpath.vectors),
    geometry=flatten(geo_5),
    context=flatten(geo_9),
    grid_size=number_slider_35,
    offset_dist=number_slider_34,
    run=boolean_toggle)  # -> out, points, results, mesh, legend, title, int_mtx; disabled; plug-in component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

materials_8 = QueryMaterials()
item_25 = ListItem(Index=Slider(77, range=0..100), Wrap=True)
geodshape_7 = AddGeometryDirectShape(Name="Exterior_Window_geometry", Geometry=geo_8, Material=item_25, TrackingMode=2)

ggifcrm_4 = GgIFCRepresentationMap(IfcRepresentationItems=geo_9)
ggifcbept_4 = GgIFCBuildingElementProxyType(PredefinedType=6, IfcRep=ggifcrm_4, Name="exteriorwalls")
ggifcb_4 = GgIFCBuilding(Name="exteriorwalls", LongName="GH Building", BuildingComposition=3, ElevationOfRefHeight=0, ElevationOfTerrain=0)
xy_4 = XYPlane(Origin=Point(0, 0, 0))
ggifce_4 = GgIFCCreateElement(IFCContainer=ggifcb_4, IfcProductType=ggifcbept_4, Location=xy_4)
ggifcp_4 = GgIFCProject(Name="exteriorwalls")
ggbake_4 = GgIFCBaketoFile(ggifce_4)

number_slider_36 = Slider(26, range=0..100)
materials_9 = QueryMaterials()
item_26 = ListItem(Index=Slider(1, range=0..1), Wrap=True)
geodshape_8 = AddGeometryDirectShape(Name="exterior_walls_geometry", Geometry=geo_9, Material=item_26, TrackingMode=2)

ggifcrm_5 = GgIFCRepresentationMap(IfcRepresentationItems=geo_6)
ggifcbept_5 = GgIFCBuildingElementProxyType(PredefinedType=6, IfcRep=ggifcrm_5, Name="middlewindow")
ggifcb_5 = GgIFCBuilding(Name="middlewindow", LongName="GH Building", BuildingComposition=3, ElevationOfRefHeight=0, ElevationOfTerrain=0)
xy_5 = XYPlane(Origin=Point(0, 0, 0))
ggifce_5 = GgIFCCreateElement(IFCContainer=ggifcb_5, IfcProductType=ggifcbept_5, Location=xy_5)
ggifcp_5 = GgIFCProject(Name="middlewindow")
ggbake_5 = GgIFCBaketoFile(ggifce_5)

ggifcrm_6 = GgIFCRepresentationMap(IfcRepresentationItems=geo_7)
ggifcbept_6 = GgIFCBuildingElementProxyType(PredefinedType=6, IfcRep=ggifcrm_6, Name="exteriorwindows")
ggifcb_6 = GgIFCBuilding(Name="exteriorwindows", LongName="GH Building", BuildingComposition=3, ElevationOfRefHeight=0, ElevationOfTerrain=0)
xy_6 = XYPlane(Origin=Point(0, 0, 0))
ggifce_6 = GgIFCCreateElement(IFCContainer=ggifcb_6, IfcProductType=ggifcbept_6, Location=xy_6)
ggifcp_6 = GgIFCProject(Name="exteriorwindows")
ggbake_6 = GgIFCBaketoFile(ggifce_6)

ggifcrm_7 = GgIFCRepresentationMap(IfcRepresentationItems=geo)
ggifcbept_7 = GgIFCBuildingElementProxyType(PredefinedType=6, IfcRep=ggifcrm_7, Name="floorplate")
ggifcb_7 = GgIFCBuilding(Name="floorplate", LongName="GH Building", BuildingComposition=3, ElevationOfRefHeight=0, ElevationOfTerrain=0)
xy_7 = XYPlane(Origin=Point(0, 0, 0))
ggifce_7 = GgIFCCreateElement(IFCContainer=ggifcb_7, IfcProductType=ggifcbept_7, Location=xy_7)
ggifcp_7 = GgIFCProject(Name="floorplate")

ggifcam = GgIFCAssignMaterial(IFCMaterial=ggifcm, IFCRootObjects=ggifce_7)
ggbake_7 = GgIFCBaketoFile(ggifcam)

ggbake_8 = GgIFCBaketoFile(ggifcam)

# ----
# BED 2
number_slider_37 = Slider(90, range=0..100)
rectangle_17 = Rectangle(Plane=PlaneXY(0, 0, 0), XSize=Slider(100, range=0..100), YSize=Slider(3150, range=0..10000), Radius=0)  # -> Rectangle, Length
X_26 = UnitX(Factor=Slider(165, range=0..1000, expression="-x"))
Y_23 = UnitY(Factor=Slider(3120, range=0..10000))
item_27 = ListItem(List=divide_2.Points, Index="31", Wrap=True)
pt_14 = Point(item_27)
# WALLS
move_83 = Move(Geometry=rectangle_17.Rectangle, Motion=pt_14)  # -> Geometry, Transform

# ----
# INTERIOR WALLS
move_84 = Move(Geometry=move_83.Geometry, Motion=X_12)  # -> Geometry, Transform

rotate_29 = Rotate(Geometry=move_84.Geometry, Angle=degrees(number_slider_37), Plane=pt_14)  # -> Geometry, Transform
move_85 = Move(Geometry=rotate_29.Geometry, Motion=Y_23)  # -> Geometry, Transform
move_86 = Move(Geometry=move_85.Geometry, Motion=X_26)  # -> Geometry, Transform
explode_5 = Explode(Curve=move_86.Geometry, Recursive=True)  # -> Segments, Vertices
item_28 = ListItem(List=explode_5.Vertices, Index="2", Wrap=True)

# ----
# SHOWER
rectangle_18 = Rectangle(Plane=PlaneXY(0, 0, 0), XSize=Slider(100, range=0..100), YSize=Slider(4105, range=0..10000), Radius=0)  # -> Rectangle, Length
Y_24 = UnitY(Factor=Slider(4494, range=0..10000))
X_27 = UnitX(Factor=Slider(2462, range=0..10000))
item_29 = ListItem(List=divide_2.Points, Index="30", Wrap=True)
pt_15 = Point(item_29)
move_87 = Move(Geometry=rectangle_18.Rectangle, Motion=pt_15)  # -> Geometry, Transform

move_88 = Move(Geometry=move_87.Geometry, Motion=Y_24)  # -> Geometry, Transform
move_89 = Move(Geometry=move_88.Geometry, Motion=X_27)  # -> Geometry, Transform

explode_6 = Explode(Curve=move_89.Geometry, Recursive=True)  # -> Segments, Vertices
item_30 = ListItem(List=explode_6.Vertices, Index="4", Wrap=True)

# ----
# DOORS
number_slider_38 = Slider(90, range=0..100, expression="-x")
Y_25 = UnitY(Factor=Slider(30, range=0..100))
X_28 = UnitX(Factor=Slider(10, range=0..10, expression="-x"))
Y_26 = UnitY(Factor=Slider(1300, range=0..10000))
Z_28 = UnitZ(Factor=Slider(3000, range=0..10000))
Y_27 = UnitY(Factor=Slider(1355, range=0..10000))
Y_28 = UnitY(Factor=Slider(10, range=0..10))
X_29 = UnitX(Factor=Slider(150, range=0..1000))
rectangle_19 = Rectangle(Plane=PlaneXY(0, 0, 0), XSize=number_slider_19, YSize=Slider(1200, range=0..10000), Radius=0)  # -> Rectangle, Length
rectangle_20 = Rectangle(Plane=PlaneXY(0, 0, 0), XSize=number_slider_19, YSize=Slider(1050, range=0..10000), Radius=0)  # -> Rectangle, Length
move_90 = Move(Geometry=rectangle_19.Rectangle, Motion=item_28)  # -> Geometry, Transform
move_91 = Move(Geometry=rectangle_19.Rectangle, Motion=item_10)  # -> Geometry, Transform
move_92 = Move(Geometry=rectangle_20.Rectangle, Motion=item_30)  # -> Geometry, Transform
move_93 = Move(Geometry=rectangle_19.Rectangle, Motion=item_15)  # -> Geometry, Transform
# DOORS
rotate_30 = Rotate(Geometry=move_90.Geometry, Angle=degrees(number_slider_38), Plane=item_28)  # -> Geometry, Transform
rotate_31 = Rotate(Geometry=move_91.Geometry, Angle=degrees(number_slider_38), Plane=item_10)  # -> Geometry, Transform
move_94 = Move(Geometry=move_93.Geometry, Motion=Y_27)  # -> Geometry, Transform
move_95 = Move(Geometry=move_92.Geometry, Motion=Y_25)  # -> Geometry, Transform
move_96 = Move(Geometry=move_92.Geometry, Motion=Y_26)  # -> Geometry, Transform
move_97 = Move(Geometry=[rotate_30.Geometry, rotate_31.Geometry], Motion=Y_28)  # -> Geometry, Transform
move_98 = Move(Geometry=move_97.Geometry, Motion=X_29)  # -> Geometry, Transform
move_99 = Move(Geometry=[move_94.Geometry, move_96.Geometry, move_95.Geometry], Motion=X_28)  # -> Geometry, Transform

# ----
# HEIGHT OF WALLS
boundary_37 = BoundarySurfaces(Edges=[move_26.Geometry, move_37.Geometry, move_33.Geometry, move_86.Geometry, move_88.Geometry, move_89.Geometry, move_34.Geometry, move_35.Geometry, move_84.Geometry, move_40.Geometry, move_38.Geometry])
Z_29 = UnitZ(Factor=Slider(4000, range=0..10000))
Z_30 = UnitZ(Factor=Slider(1500, range=0..10000))
extr_21 = Extrude(Base=boundary_37, Direction=Z_29)
extr_22 = Extrude(Base=rotax_3.Geometry, Direction=Z_30)
sdiff_21 = SolidDifference(BrepsA=extr_21, BrepsB=extr_22)

# ----
# HEIGHT OF DOORS
crv = Curve([move_98.Geometry, move_99.Geometry])
boundary_38 = BoundarySurfaces(Edges=crv)
extr_23 = Extrude(Base=boundary_38, Direction=Z_28)
sdiff_22 = SolidDifference(BrepsA=extr_23, BrepsB=extr_21)

geo_10 = Geometry(sdiff_22)

ggifcrm_8 = GgIFCRepresentationMap(IfcRepresentationItems=geo_10)
ggifcbept_8 = GgIFCBuildingElementProxyType(PredefinedType=6, IfcRep=ggifcrm_8, Name="interiordoors")
ggifcb_8 = GgIFCBuilding(Name="interiordoors", LongName="GH Building", BuildingComposition=3, ElevationOfRefHeight=0, ElevationOfTerrain=0)
xy_8 = XYPlane(Origin=Point(0, 0, 0))
ggifce_8 = GgIFCCreateElement(IFCContainer=ggifcb_8, IfcProductType=ggifcbept_8, Location=xy_8)
ggifcp_8 = GgIFCProject(Name="interiordoors")
ggbake_9 = GgIFCBaketoFile(ggifce_8)

geo_11 = Geometry(sdiff_21)

materials_10 = QueryMaterials()
item_31 = ListItem(Index=Slider(38, range=0..100), Wrap=True)
geodshape_9 = AddGeometryDirectShape(Name="doors_geometry", Geometry=geo_10, Material=item_31, TrackingMode=2)

number_slider_39 = Slider(26, range=0..100)
materials_11 = QueryMaterials()
item_32 = ListItem(Index=Slider(1, range=0..1), Wrap=True)
geodshape_10 = AddGeometryDirectShape(Name="interior_walls_geometry", Geometry=geo_11, Material=item_32, TrackingMode=2)

ggifcrm_9 = GgIFCRepresentationMap(IfcRepresentationItems=geo_11)
ggifcbept_9 = GgIFCBuildingElementProxyType(PredefinedType=6, IfcRep=ggifcrm_9, Name="interiorwalls")
ggifcb_9 = GgIFCBuilding(Name="interiorwalls", LongName="GH Building", BuildingComposition=3, ElevationOfRefHeight=0, ElevationOfTerrain=0)
xy_9 = XYPlane(Origin=Point(0, 0, 0))
ggifce_9 = GgIFCCreateElement(IFCContainer=ggifcb_9, IfcProductType=ggifcbept_9, Location=xy_9)
ggifcp_9 = GgIFCProject(Name="interiorwalls")
ggbake_10 = GgIFCBaketoFile(ggifce_9)

# ----
# INTERIOR DOORS
swatch_2 = ColourSwatch(SwatchColor=RGBA(255, 252, 252, 0))
preview_8 = CustomPreview(Geometry=sdiff_22, Material=swatch_2)

# ----
# INTERIOR WALLS
swatch_3 = ColourSwatch(SwatchColor=RGB(176, 166, 109))
preview_9 = CustomPreview(Geometry=sdiff_21, Material=swatch_3)
